# Grasshopper definition Receiver-01.ghx (Grasshopper 0.9.76)
# plug-ins: GH_CPython

toggle = BooleanToggle(True)
gh_cpython = GH_CPython(TF=toggle, table_name="mesh_180906")  # -> output, pt0, pt1, pt2; inputs TF: list, table_name: list
#   port table_name: [required] - [type = int] - [default = None] Descripe your input here * bullet point. * bullet point
#   port output: indicate your output description here. refers to a new line.
# ---------- gh_cpython: Python ----------
# -*- coding: utf-8 -*-

import psycopg2

def get_connection():

    connect_str = "dbname='postgres' user='postgres' host='localhost' port = '5432' password='postgres'"
    return psycopg2.connect(connect_str)


conn = get_connection()
cur = conn.cursor()

if TF == True:

    sql_id = "SELECT mesh_id FROM " + table_name + ";"
    cur.execute(sql_id)
    # debug = sql_id
    rows = cur.fetchall()
    #output_  = rows

    sql_0 = "SELECT pt0 FROM " + table_name + ";"
    cur.execute(sql_0)
    # debug = sql_0
    rows = cur.fetchall()
    pt0  = rows

    sql_1 = "SELECT pt1 FROM " + table_name + ";"
    cur.execute(sql_1)
    # debug = sql_1
    rows = cur.fetchall()
    pt1  = rows

    sql_2 = "SELECT pt2 FROM " + table_name + ";"
    cur.execute(sql_2)
    # debug = sql_2
    rows = cur.fetchall()
    pt2  = rows


cur.close()
conn.close()
# ---------- end gh_cpython ----------
gh_cpython_2 = GH_CPython(TF=toggle, table_name="vertex_180906")  # -> debug, output, x, y, z; inputs TF: list, table_name: list
#   port table_name: [required] - [type = int] - [default = None] Descripe your input here * bullet point. * bullet point
#   port output: indicate your output description here. refers to a new line.
# ---------- gh_cpython_2: Python ----------
# -*- coding: utf-8 -*-

import psycopg2

def get_connection():

    connect_str = "dbname='postgres' user='postgres' host='localhost' port = '5432' password='postgres'"
    return psycopg2.connect(connect_str)


conn = get_connection()
cur = conn.cursor()

if TF == True:

    sql_id = "SELECT vertex_id FROM " + table_name + ";"
    cur.execute(sql_id)
    # debug = sql_id
    rows = cur.fetchall()
    #output_  = rows

    sql_x = "SELECT ver_x FROM " + table_name + ";"
    cur.execute(sql_x)
    # debug = sql_x
    rows = cur.fetchall()
    x  = rows

    sql_y = "SELECT ver_y FROM " + table_name + ";"
    cur.execute(sql_y)
    # debug = sql_y
    rows = cur.fetchall()
    y  = rows

    sql_z = "SELECT ver_z FROM " + table_name + ";"
    cur.execute(sql_z)
    # debug = sql_z
    rows = cur.fetchall()
    z  = rows


cur.close()
conn.close()
# ---------- end gh_cpython_2 ----------
panel = Panel(gh_cpython_2.z)
dispatch = Dispatch(List=gh_cpython_2.output, DispatchPattern=[True, False])  # -> ListA, ListB
dispatch_2 = Dispatch(List=gh_cpython_2.x, DispatchPattern=[True, False])  # -> ListA, ListB
dispatch_3 = Dispatch(List=gh_cpython_2.y, DispatchPattern=[True, False])  # -> ListA, ListB
dispatch_4 = Dispatch(List=gh_cpython_2.z, DispatchPattern=[True, False])  # -> ListA, ListB
dispatch_5 = Dispatch(List=gh_cpython.pt1, DispatchPattern=[True, False])  # -> ListA, ListB
dispatch_6 = Dispatch(List=gh_cpython.pt2, DispatchPattern=[True, False])  # -> ListA, ListB
dispatch_7 = Dispatch(List=gh_cpython.pt0, DispatchPattern=[True, False])  # -> ListA, ListB
split = TextSplit(Text=dispatch.ListA, Separators="(")
split_2 = TextSplit(Text=dispatch_2.ListA, Separators="'")
split_3 = TextSplit(Text=dispatch_3.ListA, Separators="'")
split_4 = TextSplit(Text=dispatch_4.ListA, Separators="'")
item = ListItem(List=split, Index="1", Wrap=True)  # -> flatten(Item)
item_2 = ListItem(List=split_2, Index="1", Wrap=True)  # -> flatten(Item)
item_3 = ListItem(List=split_3, Index="1", Wrap=True)  # -> flatten(Item)
item_4 = ListItem(List=split_4, Index="1", Wrap=True)  # -> flatten(Item)
split_5 = TextSplit(Text=dispatch_5.ListA, Separators="(")
split_6 = TextSplit(Text=dispatch_6.ListA, Separators="(")
split_7 = TextSplit(Text=dispatch_7.ListA, Separators="(")
item_5 = ListItem(List=split_5, Index="1", Wrap=True)  # -> flatten(Item)
item_6 = ListItem(List=split_6, Index="1", Wrap=True)  # -> flatten(Item)
item_7 = ListItem(List=split_7, Index="1", Wrap=True)  # -> flatten(Item)
panel_2 = Panel(item)
panel_3 = Panel(item_2)
panel_4 = Panel(item_4)
panel_5 = Panel(item_3)
pt = ConstructPoint(XCoordinate=item_2, YCoordinate=item_3, ZCoordinate=item_4)
item_8 = ListItem(List=pt, Index=item_5, Wrap=True)
item_9 = ListItem(List=pt, Index=item_6, Wrap=True)
item_10 = ListItem(List=pt, Index=item_7, Wrap=True)
graft = GraftTree(Tree=item_10, IncludeEmptyLists=True, IncludeNullItems=True)
graft_2 = GraftTree(Tree=item_8, IncludeEmptyLists=True, IncludeNullItems=True)
graft_3 = GraftTree(Tree=item_9, IncludeEmptyLists=True, IncludeNullItems=True)
merge = Merge(Data1=graft, Data2=graft_2, Data3=graft_3)
viewer = ParamViewer(pt)
viewer_2 = ParamViewer(merge)
conmesh = ConstructMesh(Vertices=merge, Faces="Q{0,1,2}")  # -> flatten(Mesh)
mjoin = MeshJoin(Meshes=conmesh)
mesh = Mesh(mjoin)
panel_6 = Panel(mjoin)
preview = CustomPreview(
    Geometry=mesh,
    Shader={ambient=RGB(0, 0, 0), diffuse=RGB(255, 105, 180), emission=RGB(76, 32, 54), shine=0.5, specular=RGB(255, 255, 255), transparency=0})
