# Grasshopper definition Sender-01.ghx (Grasshopper 0.9.76)
# plug-ins: Weaverbird, GH_CPython

toggle = BooleanToggle(True)
sph = Sphere(Base=PlaneXY(0, 0, 0), Radius=Slider(100, range=0..100))
popgeo = PopulateGeometry(Geometry=sph, Count=Slider(12, range=0..100), Seed=1)
facet = FacetDome(Points=popgeo)  # -> Pattern, Dome
neg = Negative(Value=Slider(15, range=1..30))
wbframe = WeaverbirdsPictureFrame(MeshPolylines=facet.Pattern, Distance=Slider(30, range=1..50), InsetType=0)
wbthicken = WeaverbirdsMeshThicken(MeshCurves=wbframe, Distance=neg, OffsetType=0)
wbcatmullclark = WeaverbirdsCatmullClarkSubdivision(MeshCurves=wbthicken, Level=Slider(1, range=1..3), SmoothNakedEdges=1)
tri = Triangulate(Mesh=wbcatmullclark)  # -> Mesh, Count
mesh = Mesh(tri.Mesh)
medges = MeshEdges(Mesh=mesh)  # -> NakedEdges, InteriorEdges, NonManifoldEdges
preview = CustomPreview(
    Geometry=mesh,
    Shader={ambient=RGB(0, 0, 0), diffuse=RGB(255, 105, 180), emission=RGB(76, 32, 54), shine=0.5, specular=RGB(255, 255, 255), transparency=0})
demesh = DeconstructMesh(Mesh=mesh)  # -> Vertices, Faces, Colours, Normals
panel = Panel(demesh.Faces)
viewer = ParamViewer(demesh.Vertices)
pdecon = Deconstruct(Point=simplify(demesh.Vertices))  # -> XComponent, YComponent, ZComponent
panel_2 = Panel(pdecon.XComponent)
deface = DeconstructFace(Face=simplify(demesh.Faces))  # -> CornerA, CornerB, CornerC, CornerD
lng = ListLength(List=demesh.Vertices)
panel_3 = Panel(deface.CornerB)
viewer_2 = ParamViewer(deface.CornerA)
viewer_3 = ParamViewer(deface.CornerB)
panel_4 = Panel(deface.CornerD)
series = Series(Start=0, Step=1, Count=lng)
panel_5 = Panel(series)
int = Integer(series)
lng_2 = ListLength(List=deface.CornerA)
series_2 = Series(Start=0, Step=1, Count=lng_2)
int_2 = Integer(series_2)
int_3 = Integer(deface.CornerA)
int_4 = Integer(deface.CornerB)
int_5 = Integer(deface.CornerC)

# ---- group: Mesh Face Info
gh_cpython = GH_CPython(TF=toggle, table_name="mesh_180906", id=int_2, pt0=int_3, pt1=int_4, pt2=int_5)  # -> debug, output; inputs TF: list, table_name: list, id: list, pt0: list, pt1: list, pt2: list
#   port output: indicate your output description here. refers to a new line.
# ---------- gh_cpython: Python ----------
# -*- coding: utf-8 -*-
# Mesh Face Info

import psycopg2

def get_connection():
    connect_str = "dbname='postgres' user='postgres' host='localhost' port='5432' password='postgres'"
    return psycopg2.connect(connect_str)

id = id
pt0 = pt0
pt1 = pt1
pt2 = pt2


conn = get_connection()
cur = conn.cursor()

### SELECT : OK !!
#sql_sel = "SELECT * FROM " + table_name + " ;"
#debug = sql_sel
#cur.execute(sql_sel)
#rows = cur.fetchall()
### rows = cur.fetchone()
#output_  = rows


### DELETE : OK !!
#sql_del = "DELETE FROM " + table_name + ";"
#debug = sql_del
#cur.execute(sql_del)
#conn.commit()


if TF == True:
    
    ### SELECT : OK !!
    #sql_sel = "SELECT * FROM " + table_name + " ;"
    #debug = sql_sel
    #cur.execute(sql_sel)
    #rows = cur.fetchall()
    #output_  = rows

    
    # DELETE : OK!!
    sql_del = "DELETE FROM " + table_name + ";"
    debug = sql_del
    cur.execute(sql_del)
    conn.commit()
     

    ### INSERT : OK !!
    #i = 0
    #sql_insert = "INSERT INTO " + table_name + " (mesh_id, pt0, pt1, pt2) " + " VALUES (" + str(i) + "," + str(pt0[i]) + "," + str(pt1[i]) + "," + str(pt2[i]) + " );"
    #debug = sql_insert
    #cur.execute(sql_insert)
    #conn.commit()

    
    # INSERT : OK !!
    for i in range(len(id)): 
        sql_insert = "INSERT INTO " + table_name + " (mesh_id, pt0, pt1, pt2) " + " VALUES (" +str(i)+ "," + str(pt0[i]) + "," + str(pt1[i]) + "," + str(pt2[i]) + " );"
        debug = sql_insert
        #debug = i
        #debug = pt0[i]
        cur.execute(sql_insert)
        conn.commit()



cur.close()
conn.close()
# ---------- end gh_cpython ----------

# ---- group: Vertex Info
gh_cpython_2 = GH_CPython(TF=toggle, table_name="vertex_180906", id=int, x=pdecon.XComponent, y=pdecon.YComponent, z=pdecon.ZComponent)  # -> debug, output; inputs TF: list, table_name: list, id: list, x: list, y: list, z: list
#   port output: indicate your output description here. refers to a new line.
# ---------- gh_cpython_2: Python ----------
# -*- coding: utf-8 -*-

import psycopg2

def get_connection():
    connect_str = "dbname='postgres' user='postgres' host='localhost' port = '5432' password='postgres'"
    return psycopg2.connect(connect_str)

id = id
x = x
y = y
z = z

conn = get_connection()
cur = conn.cursor()

if TF == True:

    # DELETE : OK!!
    sql_del = "DELETE FROM " + table_name + ";"
    debug = sql_del
    cur.execute(sql_del)
    conn.commit()

    for i in range(len(id)):
        sql_insert = "INSERT INTO " + table_name +"(vertex_id, ver_x, ver_y, ver_z) VALUES (" +str(i)+ "," +str(x[i])+ "," +str(y[i])+ "," +str(z[i])+ ");"
        debug = sql_insert
        #debug = i
        #debug = pt0[i]
        cur.execute(sql_insert)
        conn.commit()

cur.close()
conn.close()
# ---------- end gh_cpython_2 ----------

# ----
panel_6 = Panel(gh_cpython.debug)
panel_7 = Panel(gh_cpython.output)
panel_8 = Panel(gh_cpython_2.debug)  # disabled
panel_9 = Panel(gh_cpython_2.output)  # disabled
