# Grasshopper definition psycopg2_cpython.ghx (Grasshopper 0.9.76)
# plug-ins: GH_CPython

panel = Panel("age")
gh_cpython = GH_CPython()  # -> output
# ---------- gh_cpython: Python ----------
# -*- coding: utf-8 -*-
""" 
Python Script
Created on  Monday September 2018 06:35:06 
@author:  yoshioca 

[desc]
Description of the plugin Here
Write here any thing... 
[/desc]

ARGUMENTS:
----------
<inp> 
    _input :[required] - [type = int] - [default = None] 
    Descripe your input here 
        * bullet point.
        * bullet point
</inp>
<inp>
    Other inputs go here ...
</inp>

RETURN:
----------
    <out>
        output_ : indicate your output description here. \n refers to a new line.
    </out>

"""

import psycopg2

def get_connection():

    connect_str = "dbname='postgres' user='postgres' host='localhost' port = '5432' password='postgres'"
    return psycopg2.connect(connect_str)


conn = get_connection()
cur = conn.cursor()

sql = "SELECT * FROM member;"
cur.execute(sql)
rows = cur.fetchall()

# print rows
output_  = rows


cur.close()
conn.close()
# ---------- end gh_cpython ----------
gh_cpython_2 = GH_CPython(input="SELECT name FROM member;")  # -> output; inputs input: list
# ---------- gh_cpython_2: Python ----------
# -*- coding: utf-8 -*-
""" 
Python Script
Created on  Monday September 2018 06:35:06 
@author:  yoshioca 

[desc]
Description of the plugin Here
Write here any thing... 
[/desc]

ARGUMENTS:
----------
<inp> 
    _input :[required] - [type = int] - [default = None] 
    Descripe your input here 
        * bullet point.
        * bullet point
</inp>
<inp>
    Other inputs go here ...
</inp>

RETURN:
----------
    <out>
        output_ : indicate your output description here. \n refers to a new line.
    </out>

"""

import psycopg2

def get_connection():

    connect_str = "dbname='postgres' user='postgres' host='localhost' port = '5432' password='postgres'"
    return psycopg2.connect(connect_str)


conn = get_connection()
cur = conn.cursor()

sql = _input
cur.execute(sql)

rows = cur.fetchall()
#rows = cur.fetchone()

# print rows
output_  = rows


cur.close()
conn.close()
# ---------- end gh_cpython_2 ----------
panel_2 = Panel(gh_cpython)
gh_cpython_3 = GH_CPython(input="name")  # -> output; inputs input: list
# ---------- gh_cpython_3: Python ----------
# -*- coding: utf-8 -*-
""" 
Python Script
Created on  Monday September 2018 06:35:06 
@author:  yoshioca 

[desc]
Description of the plugin Here
Write here any thing... 
[/desc]

ARGUMENTS:
----------
<inp> 
    _input :[required] - [type = int] - [default = None] 
    Descripe your input here 
        * bullet point.
        * bullet point
</inp>
<inp>
    Other inputs go here ...
</inp>

RETURN:
----------
    <out>
        output_ : indicate your output description here. \n refers to a new line.
    </out>

"""

import psycopg2

def get_connection():

    connect_str = "dbname='postgres' user='postgres' host='localhost' port = '5432' password='postgres'"
    return psycopg2.connect(connect_str)


conn = get_connection()
cur = conn.cursor()

in_keyword = _input
sql = "SELECT "+ in_keyword+ " FROM member;"

cur.execute(sql)

rows = cur.fetchall()
#rows = cur.fetchone()

# print rows
output_  = rows


cur.close()
conn.close()
# ---------- end gh_cpython_3 ----------
gh_cpython_4 = GH_CPython(input="SELECT * FROM member;")  # -> output; inputs input: list
# ---------- gh_cpython_4: Python ----------
# -*- coding: utf-8 -*-
""" 
Python Script
Created on  Monday September 2018 06:35:06 
@author:  yoshioca 

[desc]
Description of the plugin Here
Write here any thing... 
[/desc]

ARGUMENTS:
----------
<inp> 
    _input :[required] - [type = int] - [default = None] 
    Descripe your input here 
        * bullet point.
        * bullet point
</inp>
<inp>
    Other inputs go here ...
</inp>

RETURN:
----------
    <out>
        output_ : indicate your output description here. \n refers to a new line.
    </out>

"""

import psycopg2

def get_connection():

    connect_str = "dbname='postgres' user='postgres' host='localhost' port = '5432' password='postgres'"
    return psycopg2.connect(connect_str)


conn = get_connection()
cur = conn.cursor()

sql = _input
cur.execute(sql)
rows = cur.fetchall()

# print rows
output_  = rows


cur.close()
conn.close()
# ---------- end gh_cpython_4 ----------
dispatch = Dispatch(List=gh_cpython_3, DispatchPattern=[True, False])  # -> ListA, ListB
panel_3 = Panel(gh_cpython_2)
panel_4 = Panel(gh_cpython_4)
panel_5 = Panel(gh_cpython_3)
split = TextSplit(Text=dispatch.ListA, Separators="(")
panel_6 = Panel(dispatch.ListA)
item = ListItem(List=split, Index="1", Wrap=True)  # -> flatten(Item)
panel_7 = Panel(item)
